# Dynamo graph Hybrid_Valve_to_AccessPanel.dyn (Dynamo 3.4.1.7055)

# group: Inputs
levels = Levels("L2")
panelTypes = FamilyTypes("ARCH_AccessPanel_Wall_FaceBased:300x300_FR30")
offsetX = DoubleInput(0)
offsetY = DoubleInput(500)
offsetZ = DoubleInput(0)

levelName = Element.Name(element=levels)
levelName_Trim = String.TrimWhitespace(string=levelName)
levelName_Lower = String.ToLower(string=levelName_Trim)

# group: All Levels
# used for QA or if you later need LevelTarget
levels_Cat = Categories("OST_Levels")
levels_All = ElementsOfCategory(Category=levels_Cat)
string = StringInput("Name")
levels_Names = Element.GetParameterValueByName(element=levels_All, parameterName=string)
levels_Names_Trim = String.TrimWhitespace(string=levels_Names)
levels_Names_Lower = String.ToLower(string=levels_Names_Trim)
levels_NameMask = levels_Names_Lower == levelName_Lower
levels_Pick = List.FilterByBoolMask(list=levels_All, mask=levels_NameMask)
levelTarget = List.FirstItem(list=levels_Pick.in)

# group: Valves
# collect → “valve” family only → filter by level
valves_Cat = Categories("OST_PipeAccessory")
valves_All = ElementsOfCategory(Category=valves_Cat)
code_block = CodeBlock { "Family"; }
valves_FamName = Element.GetParameterValueByName(element=valves_All, parameterName=code_block)
typeAsString = FromObject(object=valves_FamName)
valves_FamName_Lower = String.ToLower(string=typeAsString)
code_block_2 = CodeBlock { "valve"; }
isValveMask = String.Contains(string=valves_FamName_Lower, searchFor=code_block_2)
valves_Only = List.FilterByBoolMask(list=valves_All, mask=isValveMask)
code_block_3 = CodeBlock { "Reference Level"; }
valves_LvlFallback = Element.GetParameterValueByName(element=valves_Only.in, parameterName=code_block_3)
code_block_4 = CodeBlock { "Level"; }
valves_RefLvl = Element.GetParameterValueByName(element=valves_Only.in, parameterName=code_block_4)
coalesce_a_b = CodeBlock(a=valves_LvlFallback, b=valves_RefLvl) { a == null || a == "" ? b : a; }
code_block_5 = CodeBlock { "Name"; }
getParameterValueByName = Element.GetParameterValueByName(element=coalesce_a_b, parameterName=code_block_5)
string_from_object = FromObject(object=getParameterValueByName)
valves_Lvl_Trim = String.TrimWhitespace(string=string_from_object)
valves_Lvl_Lower = String.ToLower(string=valves_Lvl_Trim)
valves_OnLevelMask = valves_Lvl_Lower == levelName_Lower
valves_OnLevel = List.FilterByBoolMask(list=valves_Only.in, mask=valves_OnLevelMask)
watch = Watch(valves_OnLevel.in)

# group: Walls
# collect → filter by level
walls_Cat = Categories("OST_Walls")
walls_All = ElementsOfCategory(Category=walls_Cat)
code_block_6 = CodeBlock { "Reference Level"; }
walls_RefLvl = Element.GetParameterValueByName(element=walls_All, parameterName=code_block_6)
code_block_7 = CodeBlock { "Level"; }
walls_LvlFallback = Element.GetParameterValueByName(element=walls_All, parameterName=code_block_7)
code_block_8 = CodeBlock { "Base Constraint"; }
walls_LvlFallbackConstraint = Element.GetParameterValueByName(element=walls_All, parameterName=code_block_8)
coalesce_a_b_c = CodeBlock(a=walls_RefLvl, b=walls_LvlFallback, c=walls_LvlFallbackConstraint) { Coalesce_W3 = (a != null && a != "") ? a : ((b != null && b != "") ? b : c); }
code_block_9 = CodeBlock { "Name"; }
getParameterValueByName_2 = Element.GetParameterValueByName(element=coalesce_a_b_c, parameterName=code_block_9)
typeAsString_2 = FromObject(object=getParameterValueByName_2)
walls_Lvl_Trim = String.TrimWhitespace(string=typeAsString_2)
walls_Lvl_Lower = String.ToLower(string=walls_Lvl_Trim)
walls_OnLevelMask = walls_Lvl_Lower == levelName_Lower
walls_OnLevel = List.FilterByBoolMask(list=walls_All, mask=walls_OnLevelMask)
watch_2 = Watch(walls_OnLevel.in)

# group: Output
elementToPoint = Python(IN[0]=valves_OnLevel.in)  # CPython3
# ---------- elementToPoint.python (43 lines) ----------
# ElementToPoint
# IN[0] = Elems (list of Revit elements)
import clr
clr.AddReference('RevitAPI'); clr.AddReference('ProtoGeometry')
from Autodesk.Revit.DB import LocationPoint, LocationCurve
from Autodesk.DesignScript.Geometry import Point as DSPt

try:
    unwrap = UnwrapElement
except NameError:
    def unwrap(x): return x

elems = [unwrap(e) for e in (IN[0] or [])]
pts = []

for e in elems:
    p = None
    loc = getattr(e, "Location", None)
    try:
        if isinstance(loc, LocationPoint) and loc.Point:
            xyz = loc.Point
            p = DSPt.ByCoordinates(xyz.X, xyz.Y, xyz.Z)
        elif isinstance(loc, LocationCurve) and loc.Curve:
            mid = loc.Curve.Evaluate(0.5, True)
            p = DSPt.ByCoordinates(mid.X, mid.Y, mid.Z)
        else:
            # transform origin → fallback
            try:
                xyz = e.GetTransform().Origin
                p = DSPt.ByCoordinates(xyz.X, xyz.Y, xyz.Z)
            except:
                # bbox center → last fallback
                bb = e.get_BoundingBox(None)
                if bb:
                    cx = 0.5*(bb.Min.X + bb.Max.X)
                    cy = 0.5*(bb.Min.Y + bb.Max.Y)
                    cz = 0.5*(bb.Min.Z + bb.Max.Z)
                    p = DSPt.ByCoordinates(cx, cy, cz)
    except:
        p = None
    pts.append(p)

OUT = pts
# ----------------------------------------
sort_Ydesc_Xasc_Basic = Python(IN[0]=elementToPoint, IN[1]=valves_OnLevel.in)  # CPython3
# ---------- sort_Ydesc_Xasc_Basic.python (28 lines) ----------
# Sort_Ydesc_Xasc_Basic
# IN[0] = Pts, IN[1] = Elems
try:
    unwrap = UnwrapElement
except NameError:
    def unwrap(x): return x

pts   = IN[0] or []
elems = IN[1] or []

rows = []
for i, (p, e) in enumerate(zip(pts, elems)):
    if p is None: 
        continue
    try:
        x = float(p.X); y = float(p.Y)
    except:
        continue
    # stable tiebreaker by ElementId (or index)
    try:
        uid = int(unwrap(e).Id.IntegerValue)
    except:
        try: uid = int(unwrap(e).Id)
        except: uid = i
    rows.append( (-round(y,6), round(x,6), uid, e) )

rows.sort()
OUT = [r[3] for r in rows]
# ----------------------------------------
valvePanels_Place = Python(IN[0]=sort_Ydesc_Xasc_Basic, IN[1]=walls_OnLevel.in, IN[2]=panelTypes, IN[3]=offsetX, IN[4]=offsetY, IN[5]=offsetZ)  # CPython3
# ---------- valvePanels_Place.python (312 lines) ----------
# ValvePanels_Place v15 — SINGLE placement per valve, even with mirrored offsets; reuse + consolidate duplicates
# Inputs:
#   IN[0] Valves (list; sorted OK)
#   IN[1] Walls (unused by raycast version; kept for signature)
#   IN[2] PanelTypeName (FamilySymbol from "Family Types")  ← REQUIRED
#   IN[3] OffsetX_mm, IN[4] OffsetY_mm, IN[5] OffsetZ_mm
# Output (dict):
#   { "PlacedPanels":[FamilyInstance,...], "Skipped":[Valve,...], "Messages":[str,...] }

import clr, math, traceback
clr.AddReference('RevitAPI'); clr.AddReference('RevitServices')
from Autodesk.Revit.DB import *
from RevitServices.Persistence import DocumentManager
from RevitServices.Transactions import TransactionManager

doc = DocumentManager.Instance.CurrentDBDocument
MM_TO_FT = 1.0/304.8

# ---------- helpers ----------
try:
    unwrap = UnwrapElement
except NameError:
    def unwrap(x): return x

def ensure_list(x):
    return [] if x is None else (list(x) if isinstance(x, (list, tuple)) else [x])

def elem_point(e):
    loc = getattr(e, "Location", None)
    if isinstance(loc, LocationPoint) and loc.Point:
        return loc.Point
    if isinstance(loc, LocationCurve) and loc.Curve:
        return loc.Curve.Evaluate(0.5, True)
    bb = e.get_BoundingBox(None)
    if bb:
        return XYZ((bb.Min.X + bb.Max.X)/2.0,
                   (bb.Min.Y + bb.Max.Y)/2.0,
                   (bb.Min.Z + bb.Max.Z)/2.0)
    return None

def resolve_symbol(sym_in):
    try:
        if isinstance(sym_in, FamilySymbol): return sym_in
    except: pass
    try:
        fs = unwrap(sym_in)
        if isinstance(fs, FamilySymbol): return fs
    except: pass
    return None

def get_val_id(e):
    try:
        p = e.LookupParameter("VAL_ID")
        s = p.AsString() if p else None
        if s and s.strip(): return s.strip()
    except: pass
    try: return str(e.Id.IntegerValue)
    except: return str(e.Id)

def find_or_create_clean_3d(doc):
    v3d = None
    for v in FilteredElementCollector(doc).OfClass(View3D).WhereElementIsNotElementType():
        if not v.IsTemplate:
            v3d = v; break
    if v3d is None:
        vft = None
        for t in FilteredElementCollector(doc).OfClass(ViewFamilyType):
            if t.ViewFamily == ViewFamily.ThreeDimensional:
                vft = t; break
        if vft:
            v3d = View3D.CreateIsometric(doc, vft.Id)
    if v3d:
        try:
            if v3d.ViewTemplateId and (v3d.ViewTemplateId != ElementId.InvalidElementId):
                v3d.ViewTemplateId = ElementId.InvalidElementId
        except: pass
        try:
            if hasattr(v3d,'IsSectionBoxActive') and v3d.IsSectionBoxActive:
                v3d.IsSectionBoxActive = False
        except: pass
        try: v3d.PartsVisibility = PartsVisibility.ShowOriginal
        except: pass
    return v3d

def nearest_wall_face_by_rays(pt, intersector):
    best = (None, None, float("inf"))  # (ref, face, dist)
    for k in range(24):
        a = (2.0*math.pi)*(k/24.0)
        d = XYZ(math.cos(a), math.sin(a), 0.0)
        try: rwc = intersector.FindNearest(pt, d)
        except: rwc = None
        if not rwc: continue
        ref = rwc.GetReference()
        el  = doc.GetElement(ref.ElementId) if ref else None
        if not el: continue
        face = el.GetGeometryObjectFromReference(ref)
        if not isinstance(face, Face): continue
        if rwc.Proximity < best[2]:
            best = (ref, face, rwc.Proximity)
    return best

def face_axes_at_point(face, p3d):
    res = face.Project(p3d)  # IntersectionResult
    if res:
        uv = getattr(res, "UVPoint", None) or res
        base = face.Evaluate(uv)
        try: n = face.ComputeNormal(uv).Normalize()
        except: n = face.FaceNormal.Normalize()
    else:
        base = p3d
        n = face.FaceNormal.Normalize()
    up = XYZ.BasisZ
    r  = n.CrossProduct(up)
    if r.IsZeroLength(): r = up.CrossProduct(n)
    return n.Normalize(), r.Normalize(), up, base

def bb_center(inst):
    bb = inst.get_BoundingBox(None)
    if not bb: return None
    return XYZ((bb.Min.X + bb.Max.X)/2.0,
               (bb.Min.Y + bb.Max.Y)/2.0,
               (bb.Min.Z + bb.Max.Z)/2.0)

def any_existing_near(points_ft, fsym, val_id, tol_mm=350.0):
    """Return an existing panel instance if any candidate point is near it.
       Match if Comments==VAL_ID OR same type symbol."""
    tol_ft = tol_mm * MM_TO_FT
    col = FilteredElementCollector(doc).OfCategory(BuiltInCategory.OST_GenericModel).OfClass(FamilyInstance)
    for inst in col:
        try:
            c = bb_center(inst)
            if not c: continue
            # near any candidate?
            near = any(c.DistanceTo(p) <= tol_ft for p in points_ft)
            if not near: 
                continue
            # match either by Comments or by type
            com_ok = False
            p = inst.LookupParameter("Comments")
            if p and (p.AsString() or "").strip() == val_id:
                com_ok = True
            type_ok = bool(inst.Symbol and fsym and inst.Symbol.Id == fsym.Id)
            if com_ok or type_ok:
                # ensure Comments set to VAL_ID
                if p and (p.AsString() or "").strip() != val_id:
                    try: p.Set(val_id)
                    except: pass
                return inst
        except:
            pass
    return None

def collect_near_panels(points_ft, fsym, val_id, tol_mm=350.0):
    """Return list of panel instances within tol of any candidate, matching same type or val_id."""
    tol_ft = tol_mm * MM_TO_FT
    out = []
    col = FilteredElementCollector(doc).OfCategory(BuiltInCategory.OST_GenericModel).OfClass(FamilyInstance)
    for inst in col:
        try:
            c = bb_center(inst)
            if not c: continue
            if not any(c.DistanceTo(p) <= tol_ft for p in points_ft):
                continue
            p = inst.LookupParameter("Comments")
            com_ok = (p and (p.AsString() or "").strip() == val_id)
            type_ok = bool(inst.Symbol and fsym and inst.Symbol.Id == fsym.Id)
            if com_ok or type_ok:
                out.append(inst)
        except:
            pass
    return out

def consolidate_duplicates(desired_pt, candidates_ft, fsym, val_id, tol_mm=350.0):
    """
    If more than one panel exists near the candidates, keep the one closest to desired_pt.
    Delete the rest. Returns (kept_instance, removed_count).
    """
    cand = collect_near_panels(candidates_ft, fsym, val_id, tol_mm=tol_mm)
    if len(cand) <= 1:
        return (cand[0] if cand else None, 0)
    # pick the one closest to desired_pt
    cand_sorted = sorted(cand, key=lambda inst: bb_center(inst).DistanceTo(desired_pt))
    keep = cand_sorted[0]
    to_remove = cand_sorted[1:]
    # subtransaction to delete extras
    st = SubTransaction(doc); st.Start()
    try:
        ids = List[ElementId]([inst.Id for inst in to_remove])
    except:
        ids = [inst.Id for inst in to_remove]
    try:
        # handle both .NET List and Python list
        if isinstance(ids, list):
            for _id in ids:
                doc.Delete(_id)
        else:
            doc.Delete(ids)
        st.Commit()
        return (keep, len(to_remove))
    except:
        st.RollBack()
        return (keep, 0)

# ---------- inputs ----------
Valves_in = ensure_list(IN[0])
# IN[1] Walls unused in ray path
PanelType = IN[2]
ox_mm = float(IN[3] or 0); oy_mm = float(IN[4] or 0); oz_mm = float(IN[5] or 0)
ox, oy, oz = ox_mm*MM_TO_FT, oy_mm*MM_TO_FT, oz_mm*MM_TO_FT

placed, skipped, msgs = [], [], []

try:
    fsym = resolve_symbol(PanelType)
    if not fsym:
        OUT = {"PlacedPanels":[], "Skipped":[], "Messages":["PANEL_TYPE_INPUT: use a 'Family Types' node (FamilySymbol) directly"]}
    else:
        # Prepare 3D raycast view
        TransactionManager.Instance.EnsureInTransaction(doc)
        v3d = find_or_create_clean_3d(doc)
        if not v3d:
            TransactionManager.Instance.TransactionTaskDone()
            OUT = {"PlacedPanels":[], "Skipped":[], "Messages":["NO_3D_VIEW: could not get/create a 3D view"]}
        else:
            ef = ElementCategoryFilter(BuiltInCategory.OST_Walls)
            ri = ReferenceIntersector(ef, FindReferenceTarget.Face, v3d)

            # ensure symbol active
            try:
                if not hasattr(fsym,"IsActive") or (hasattr(fsym,"IsActive") and not fsym.IsActive):
                    fsym.Activate(); doc.Regenerate()
            except: pass

            # de-dup valves by Id
            seen = set(); valves = []
            for x in Valves_in:
                v = unwrap(x)
                if v is None: continue
                try: vid = v.Id.IntegerValue
                except: vid = int(str(v.Id))
                if vid in seen: continue
                seen.add(vid); valves.append(v)

            # we will not hold one big transaction to allow inter-run visibility; use subtransactions per valve
            TransactionManager.Instance.TransactionTaskDone()

            for v in valves:
                vp = elem_point(v)
                if vp is None:
                    skipped.append(v); msgs.append("Skip: valve has no point"); continue

                # open per-valve subtransaction
                st = SubTransaction(doc); st.Start()
                try:
                    ref, face, _ = nearest_wall_face_by_rays(vp, ri)
                    if not ref or not face:
                        skipped.append(v); msgs.append("Skip: raycast found no wall face"); st.RollBack(); continue

                    n, r, up, base = face_axes_at_point(face, vp)

                    # desired (+ox,+oy,+oz) and mirrored X/Y candidates
                    dx = r.Multiply(float(ox));  dy = up.Multiply(float(oy));  dz = n.Multiply(float(oz))
                    dx_neg = r.Multiply(float(-ox)); dy_neg = up.Multiply(float(-oy))
                    cand_desired = base.Add(dx).Add(dy).Add(dz)
                    cand_mirrorX = base.Add(dx_neg).Add(dy).Add(dz)
                    cand_mirrorY = base.Add(dx).Add(dy_neg).Add(dz)
                    candidates = [cand_desired, cand_mirrorX, cand_mirrorY]

                    val_id = get_val_id(v)

                    # reuse-first: if any existing near candidates → skip create (and update Comments)
                    existing = any_existing_near(candidates, fsym, val_id, tol_mm=450.0)
                    if existing:
                        msgs.append("KeepExisting: {}".format(val_id))
                        st.Commit()
                        skipped.append(v)
                        continue

                    # create single instance at desired point
                    try:
                        inst = doc.Create.NewFamilyInstance(ref, cand_desired, up, fsym)
                    except Exception as ex:
                        msgs.append("Fail:create: {}".format(ex))
                        st.RollBack()
                        skipped.append(v)
                        continue

                    # write VAL_ID
                    try:
                        p = inst.LookupParameter("Comments")
                        if p: p.Set(val_id)
                    except: pass

                    # commit so another evaluation sees it
                    st.Commit()

                    # consolidate duplicates (if some parallel evaluation placed an extra)
                    kept, removed = consolidate_duplicates(cand_desired, candidates, fsym, val_id, tol_mm=450.0)
                    if removed > 0:
                        msgs.append("Consolidated: {} duplicates removed for {}".format(removed, val_id))
                    placed.append(kept or inst)
                    msgs.append("OK: {}".format(val_id))

                except Exception as ex2:
                    try: st.RollBack()
                    except: pass
                    skipped.append(v); msgs.append("ERROR(valve): "+str(ex2))

            OUT = {"PlacedPanels": placed, "Skipped": skipped, "Messages": msgs}

except Exception as ex:
    OUT = {"PlacedPanels":[], "Skipped":[], "Messages":["ERROR: "+str(ex), traceback.format_exc()]}
# ----------------------------------------
watch_3 = Watch(valvePanels_Place)
