# Dynamo graph MEP_AirTerminal_AutoNumber_ByLevel.dyn (Dynamo 3.4.1.7055)

# group: Inputs
levelName = StringInput("l2")
prefix = StringInput("SD-")

# group: Level Filter
categories = Categories("OST_Levels")
allLevels = ElementsOfCategory(Category=categories)
levelNames = Element.Name(element=allLevels)
levelNamesTrim = String.TrimWhitespace(string=levelNames)
levelNamesLower = String.ToLower(string=levelNamesTrim)
levelNameTrim = String.TrimWhitespace(string=levelName)
levelNamesLower_2 = String.ToLower(string=levelNameTrim)
levelMask = levelNamesLower == levelNamesLower_2
levelsFiltered = List.FilterByBoolMask(list=allLevels, mask=levelMask)
levelTarget = List.FirstItem(list=levelsFiltered.in)
name = Level.Name(level=levelTarget)

# group: Terminals on Level
categories_2 = Categories("OST_DuctTerminal")
allTerms = ElementsOfCategory(Category=categories_2)
code_block = CodeBlock { "Level"; }
getParameterValueByName = Element.GetParameterValueByName(element=allTerms, parameterName=code_block)
name_2 = Level.Name(level=getParameterValueByName)
levelCompare = name == name_2
termsOnLevel = List.FilterByBoolMask(list=allTerms, mask=levelCompare)
watch = Watch(termsOnLevel.in)

# group: Coordination
elementToPoint = Python(IN[0]=termsOnLevel.in)  # CPython3
# ---------- elementToPoint.python (37 lines) ----------
# IN[0] = Elems (list of Revit elements)
import clr
clr.AddReference('RevitAPI')
clr.AddReference('ProtoGeometry')
from Autodesk.Revit.DB import LocationPoint, LocationCurve
from Autodesk.DesignScript.Geometry import Point as DSPt

elems = UnwrapElement(IN[0] or [])
pts = []

for e in elems:
    p_ds = None
    loc = getattr(e, "Location", None)
    try:
        if isinstance(loc, LocationPoint) and loc.Point:
            xyz = loc.Point
            p_ds = DSPt.ByCoordinates(xyz.X, xyz.Y, xyz.Z)
        elif isinstance(loc, LocationCurve) and loc.Curve:
            mid = loc.Curve.Evaluate(0.5, True)  # midpoint (parameterized)
            p_ds = DSPt.ByCoordinates(mid.X, mid.Y, mid.Z)
        else:
            # fallback: transform origin or bbox center
            try:
                xyz = e.GetTransform().Origin
                p_ds = DSPt.ByCoordinates(xyz.X, xyz.Y, xyz.Z)
            except:
                bb = e.get_BoundingBox(None)
                if bb:
                    cx = (bb.Min.X + bb.Max.X) * 0.5
                    cy = (bb.Min.Y + bb.Max.Y) * 0.5
                    cz = (bb.Min.Z + bb.Max.Z) * 0.5
                    p_ds = DSPt.ByCoordinates(cx, cy, cz)
    except:
        p_ds = None
    pts.append(p_ds)

OUT = pts
# ----------------------------------------
watch_2 = Watch(elementToPoint)

elemsSorted = Python(IN[0]=elementToPoint, IN[1]=termsOnLevel.in)  # CPython3
# ---------- elemsSorted.python (31 lines) ----------
# IN[0] = Pts  (DesignScript Points from ElementToPoint or ByCoordinates)
# IN[1] = Elems (Air Terminal elements on the chosen Level)

pts   = IN[0] or []
elems = IN[1] or []

rows = []
for i, (p, e) in enumerate(zip(pts, elems)):
    if p is None:
        continue
    # read coordinates (DesignScript Point has .X/.Y)
    try:
        x = float(p.X)
        y = float(p.Y)
    except:
        continue

    # stable tiebreaker: ElementId (fallback to original index)
    try:
        uid = UnwrapElement(e).Id.IntegerValue
    except:
        uid = i

    # tuple key: Y↓ (so use -y), then X↑, then id
    rows.append((-round(y, 6), round(x, 6), uid, e))

# sort by the tuple key
rows.sort()

# return elements in sorted order
OUT = [r[3] for r in rows]
# ----------------------------------------

# group: Output
paramName = StringInput("AT_Number")
paramName_2 = StringInput("Elevation")
elevs = Element.GetParameterValueByName(element=allLevels, parameterName=paramName_2)
allLvlsSorted = List.SortByKey(list=allLevels, keys=elevs)
lvlIdsSorted = Element.Id(element=allLvlsSorted.sortedList)
targetId = Element.Id(element=levelTarget)
idx0 = List.IndexOf(list=lvlIdsSorted, element=targetId)
number = DoubleInput(1)
levelIndex = idx0 + number
number_2 = DoubleInput(100)
block = levelIndex * number_2
number_3 = DoubleInput(1)
N = List.Count(list=elemsSorted)
ordinals = Sequence(start=number_3, amount=N, step=number_3)
finalNums = block + ordinals
tagsFinal = CodeBlock(Prefix=prefix, FinalNums=finalNums) { Prefix + FinalNums; }
writeAT_Number = Element.SetParameterByName(element=elemsSorted, parameterName=paramName, value=tagsFinal)
watch_3 = Watch(tagsFinal)
